# Requirement set EPSRequirements (R2024b)

## 1 [EPS-3.01] Power Generation (Informational)
The EPS shall generate power using solar panels mounted on the satellite body

### 1.1 [EPS-4.01] Solar Input Measurement
The EPS shall read current and voltage measurements from each panel individually
Rationale: Individual reading allows us to confirm the optimal functioning of each panel and can also be used for course attitude estimation as a sanity check

### 1.2 [EPS-4.02] MPPT
The EPS should implement maximum power point tracking and control techniques for maximising power generation

## 2 [EPS-3.02] Battery (Informational)
The EPS shall include batteries for energy storage

### 2.1 [#12] Battery Capacity
The battery capacity shall be atleast:
- TBD Wh for Target
- TBD Wh for Chaser

### 2.2 [#13] Depth of Discharge (DoD)
The maximum DoD shall be:
- TBD % on Target
- TBD % on Chaser

### 2.3 [#14] C-Rating
The battery pack should have a minimum C-rating of:
- TBD on Target
- TBD on Chaser

### 2.4 [#15] Battery Management
CubeSats shall incorporate battery circuit protection for charging/discharging to avoid unbalanced cell conditions. Additional manufacturer documentation and/or testing will be required for modified, customized, or non-UL-listed cells
Rationale: CDS Rev14 Electrical Specifications

### 2.5 [#25] Battery Heater
The EPS shall include a battery heater which will regulate the battery temperature within TBD range

## 3 [EPS-3.03] Power Consumption
The EPS shall support power consumption of all onboard systems

## 4 [EPS-3.04] Size/Volume
The EPS shall occupy not more than 0.32 U on Target and 0.52 U on Chaser

## 5 [EPS-3.05] Mass
The EPS shall not weigh more than 713 g (Target) and 778 g (Chaser)

## 6 [EPS-3.07] Power Sharing Post-Docking
The EPS shall have capability to share power through docking port in docked state

### 6.1 [EPS-3.06] Power Sharing Pre-Separation
The EPS shall have capability of power sharing in combined 6U state pre-separation

## 7 [EPS-3.09] Communication with OBC
The EPS shall communicate with the OBC to provide HM data and receive commands

### 7.1 [#29] Heartbeat

### 7.2 [#30] Health Monitoring Data
The HM Data shall include the Solar Panel Currents, Voltages and Power, Vmp computed, Battery Voltage, Battery SoC, Line Voltage, Line Current etc. (not exhaustive)

## 8 [EPS-3.10] Independent Power Cycling
The EPS shall have the capability to power cycle each subsystem independently

### 8.1 [#26] Voltage and Current Monitoring
The EPS shall read the voltage and current drawn from each subsystem independently to monitor over-voltage and over-current conditions

### 8.2 [#27] Current Limiting
The EPS shall have a current limiter that latches the maximum current drawn to prevent over-current conditions

### 8.3 [#28] Subystem Power Reset Counter
The EPS shall keep track of faults and power cyles and communicate this to the OBC

## 9 [#17] Operational State Pre-Deployment
To prevent CubeSat from activating any powered functions, the CubeSat power system shall be at a power off state from the time of delivery to the launch vehicel through on-orbit deployment

### 9.1 [#18] Battery Protection Power Status (Informational)
Powered-on battery protection circuitry may be permitted
Rationale: CDS Rev14 Electrical Specifications

## 10 [#19] Remove Before Flight
The CubeSat shall include an RBF pin, which cuts all power to the satellite once it is inserted into the satellite

### 10.1 [#22] Location
The RBF pin and all CubeSat umbilical connectors shall be within the designated access port locations if available on the CubeSat’s dispenser
Comment: Please contact the manufacturer for specific charging and diagnostic port locations and procedures.

### 10.2 [#20] Removal
Access to the CubeSat is not guaranteed during or after integration. The RBF pin shall be removed from the CubeSat before integration into the dispenser, if the dispenser does not have access ports.

### 10.3 [#21] Mechanical
The RBF pin shall protrude no more than 6.5 mm from the CubeSat rail surface when it is fully inserted into the satellite

## 11 [#31] Charging Port
The EPS shall have a charging port for battery charging and powering the system during on-ground testing